# Grasshopper definition DeserialiseToXML.gh (Grasshopper 1.0.7)

panel = Panel("""0
123
60000""")
panel_2 = Panel("""0
1
2""")
panel_3 = Panel("""1000
2000
3000""")
c_script = CSharpScript(ITEMID=panel, COLOR=panel_2, QUANTITY=panel_3)  # -> out, INVENTORY; inputs ITEMID: list of Int32, COLOR: list of Int32, QUANTITY: list of Int32
# ---------- c_script: C# usings ----------
using System.Xml.Serialization;
using System.Reflection;
using System.IO;
# ---------- c_script: C# ----------
    var legoItems = new List<LegoItem>();

    for (int i = 0; i < ITEMID.Count; i++)
    {
      var piece = new LegoItem("P", ITEMID[i], COLOR[i], QUANTITY[i]);
      legoItems.Add(piece);
    }



    var _inventory = new Inventory(legoItems).SerializeToString();

    INVENTORY = _inventory;
# ---------- c_script: C# additional code ----------
  public class LegoItem
  {
    [XmlElement("ITEMTYPE")]
    public string ItemType = "P";

    [XmlElement("MINQTY")]
    public int NumberOfItem;

    [XmlElement("COLOR")]
    public int Color;

    [XmlElement("ITEMID")]
    public int Id;


    public LegoItem()
    {
    }


    public LegoItem(string itemType, int numberOfItem, int color, int id)
    {
      this.ItemType = itemType;
      this.NumberOfItem = numberOfItem;
      this.Color = color;
      this.Id = id;
    }


    public string SerializeToString()
    {
      // serialize
      XmlSerializer serializer = new XmlSerializer(typeof(LegoItem));
      using (TextWriter writer = new StringWriter())
      {
        serializer.Serialize(writer, this);
        return writer.ToString();
      }
    }
  }


  [System.Serializable]
  [XmlRoot("INVENTORY")]
  public class Inventory
  {
    [XmlElement("ITEM")]
    public List<LegoItem> LegoItems;

    public Inventory()
    {
    }

    public Inventory(List<LegoItem> legoItems)
    {
      this.LegoItems = legoItems;
    }


    public string SerializeToString()
    {


      var xns = new XmlSerializerNamespaces();
      xns.Add(string.Empty, string.Empty);


      // serialize
      XmlSerializer serializer = new XmlSerializer(typeof(Inventory));
      using (TextWriter writer = new StringWriter())
      {
        serializer.Serialize(writer, this, xns);
        return writer.ToString();
      }
    }


  }
# ---------- end c_script ----------
panel_4 = Panel(c_script.INVENTORY)
