# Grasshopper definition gioconda_simplified.gh (Grasshopper 1.0.7)
# plug-ins: Javid, MeshEdit Components, Weaverbird

# ----
# Available Dataset
path = FilePath("/Users/mp/Documents/GitHub/qr-art.github.io/LegoPaint/Database/1x1_LegoColors.csv")
file = ReadFile(File=path, PerLineParse=True)
panel = Panel(file)

split_list = SplitList(List=panel, Index="2")  # -> ListA, ListB
split = TextSplit(Text=split_list.ListB, Separators=",")
item = ListItem(List=split, Index=0, Wrap=True)  # -> flatten(Item), flatten(Item1), flatten(Item2)
panel_2 = Panel(item.Item)
python = GhPythonScript(hex=panel_2)  # -> rgb
# ---------- python: Python ----------
__author__ = "Marco"
__version__ = "2022.11.23"

import rhinoscriptsyntax as rs
import System

a = tuple(int(hex[i:i+2], 16) for i in (0, 2, 4))

rgb = System.Drawing.Color.FromArgb(a[0], a[1], a[2])
# ---------- end python ----------
path_2 = FilePath("/Users/mp/Documents/GitHub/qr-art.github.io/pixel-art/assets/gioconda_square.jpg")
lng = ListLength(List=python)
open = OpenBitmap(File=path_2)
series = Series(Start=0, Step=1, Count=lng)
division = Division(A="48", B=Slider(2, range=1..4))
format = Format(
    Format="{4}, Code {0} - {1}, HEX {2}, {3}",
    Culture=127,
    Data0=item.Item1,
    Data1=item.Item2,
    Data2=item.Item,
    Data3=python,
    Data4=series)
division_2 = Division(A="40")
legend = Legend(Colour=python, Tags=format, LegendType=1)
pixelart = PixelArt(Bitmap=open, Palette=python, Ex=division, Size="1")  # -> Bitmap, Mesh
explode = MeshExplode(Mesh=pixelart.Mesh, Interpolate=False)
panel_3 = Panel(pixelart.Mesh)
wbcatmullclark = WeaverbirdsCatmullClarkSubdivision(MeshCurves=explode, Level=1, SmoothNakedEdges=0)  # -> flatten(OutputMeshCurves)
mjoin = MeshJoin(Meshes=wbcatmullclark)
panel_4 = Panel(mjoin)
