# Grasshopper definition legoPaint.gh (Grasshopper 1.0.7)
# plug-ins: Noise, MeshEdit Components, NGon

number_slider = Slider(2, range=2..6)
sqgrid = Square(Plane=PlaneXY(0, 0, 0), Size="6.16", ExtentX="2", ExtentY="2")  # -> Cells, Points
crv = Curve(sqgrid.Cells)
mplane = MeshPlane(Boundary=crv, WidthCount="32", HeightCount="32")  # -> Mesh, Area
mesh_join = MeshJoin(Meshes=flatten(mplane.Mesh))
face_normals = FaceNormals(Mesh=mplane.Mesh)  # -> flatten(Centers), Normals

# ----
# Perlin Noise 2d
panel = Panel("2")
series = Series(Start=0, Step=panel, Count="50")
number_slider_2 = Slider(2.1, range=1..10)
vector_xyz = VectorXYZ(XComponent=Slider(-0.5, range=-0.5..0.5), YComponent=Slider(-0.5, range=-0.5..0.5), ZComponent=0)  # -> Vector, Length
perlinnoise = PerlinNoise(
    Points=face_normals.Centers,
    Seed=0,
    Amplitude=1,
    SmoothStep=0,
    FrequecyX=number_slider_2,
    FrequecyY=number_slider_2,
    FrequecyZ=number_slider_2,
    Jitter=Slider(0, range=-1..1),
    AlignVector=vector_xyz.Vector)
pi = Pi(Factor=1)
multiplication = Multiplication(A=perlinnoise, B=pi, C=Slider(5, range=1..5))
sine = Sine(Value=multiplication)
stream_filter = StreamFilter(Gate="1", Stream0=perlinnoise, Stream1=sine)

series_2 = Series(Start=0, Step=panel, Count="25")
mesh_explode = MeshExplode(Mesh=mesh_join, Interpolate=False)
ghpython_script = GhPythonScript()  # -> out, r, g, b
# ---------- ghpython_script: Python ----------
colors =    {1:"124,92,66",
             2: "126,156,134",
             3: "102,43,50",
             4:  "80,44,25",
             5: "147,148,147",
             6: "101,101,101",
             7: "209,130,60",
             8: "83,161,90",
             9: "174,37,26",
             10: "130,95,154",
             11: "42,60,99",
             12: "237,199,67",
             13: "53,96,171",
             14: "176,163,118",
             15: "76,76,76",
             16: "215,215,215",
             17: "133,79,53",
             18: "164,182,215",
             19: "233,184,154",
             20: "58,81,61",
             21: "72,126,167",
             22: "159,188,83",
             23: "87,68,141",
             24: "198,68,156",
             25: "65,137,133",
             26: "61,47,21",
             27: "108,156,180",
             28: "132,64,120",
             29: "185,205,200",
             30: "248,226,129",
             31: "103,108,55",
             32: "228,154,197",
             33: "228,162,68"}

keys = colors.keys()

r = []
g = []
b = []

for i in keys:
    a = colors[i]

    items = a.split(",")

    r.append( items[0] )
    g.append( items[1] )
    b.append( items[2] )
# ---------- end ghpython_script ----------
colour_rgb = ColourRGB(Alpha=255, Red=ghpython_script.r, Green=ghpython_script.g, Blue=ghpython_script.b)
list_length = ListLength(List=colour_rgb)
mesh_colours = MeshColours(Colours=[RGB(140, 249, 0), RGB(0, 116, 0), RGB(36, 153, 44), RGB(137, 247, 0), RGB(168, 210, 64), RGB(184, 250, 60), RGB(53, 209, 64), RGB(165, 248, 168)])
series_3 = Series(Start=0, Step=1, Count=list_length)
legend = Legend(Colour=colour_rgb, Tags=series_3, LegendType=1)
panel_2 = Panel("""10
11
12""")
panel_3 = Panel("""8
11
7
20""")
list_item = ListItem(List=colour_rgb, Index=panel_2, Wrap=True)
list_item_2 = ListItem(List=colour_rgb, Index=panel_3, Wrap=True)
entwine = Entwine(
    Branch00=ColourSwatch(SwatchColor=RGB(255, 135, 0)),
    Branch01=ColourSwatch(SwatchColor=RGB(255, 202, 0)),
    Branch02=ColourSwatch(SwatchColor=RGB(255, 44, 0)),
    FlattenInputs=True)
entwine_2 = Entwine(
    Branch00=ColourSwatch(SwatchColor=RGB(13, 0, 0)),
    Branch01=ColourSwatch(SwatchColor=RGBA(0, 0, 0, 161)),
    Branch02=ColourSwatch(SwatchColor=RGBA(0, 0, 0, 85)),
    Branch03=ColourSwatch(SwatchColor=RGBA(0, 0, 0, 0)),
    FlattenInputs=True)
graft_tree = GraftTree(Tree=list_item, IncludeEmptyLists=True, IncludeNullItems=True)
graft_tree_2 = GraftTree(Tree=list_item_2, IncludeEmptyLists=True, IncludeNullItems=True)
value_list = ValueList({"0", "1", "2", "3", "4", "5"}, selected="3")
stream_filter_2 = StreamFilter(Gate=value_list, Stream0=entwine, Stream1=entwine_2, Stream2=graft_tree, Stream3=graft_tree_2)
tree_statistics = TreeStatistics(Tree=stream_filter_2)  # -> Paths, Length, Count
data = Data(stream_filter)
kmeans = KMeans(NumberOfClusters=tree_statistics.Count, D=data, D_2=data, D_3=data)  # -> Index, DataTree
param_viewer = ParamViewer(kmeans.DataTree)
jitter = Jitter(List=param_viewer, Jitter=1, Seed=Slider(14, range=0..20))  # -> Values, Indices
tree_branch = TreeBranch(Tree=kmeans.DataTree, Path=jitter.Values, MaintainPaths=False)
list_item_3 = ListItem(List=mesh_explode, Index=tree_branch, Wrap=True)
mesh_colours_2 = MeshColours(Mesh=list_item_3, Colours=graft(stream_filter_2))  # -> flatten(Mesh)
mesh_join_2 = MeshJoin(Meshes=mesh_colours_2)
curve = Curve(flatten(crv))
cluster = Data(tree_branch)
ghpython_script_2 = GhPythonScript(Cluster=cluster, iCurve=curve, platePrice="8.99", brickPrice="0.06")  # -> out, totalCost; inputs Cluster: tree of Int32, iCurve: list of Curve
# ---------- ghpython_script_2: Python ----------
__author__ = "mpmac"

import rhinoscriptsyntax as rs


number_of_tree = Cluster.BranchCount
for i in range(number_of_tree):
    value = Cluster.Branch(i).Count
    print "Cluster {0}: {1:4} pcs".format(i+1,value)

number_of_brick = Cluster.DataCount

brickCost = number_of_brick * brickPrice

number_of_plate = len(iCurve)
plateCost = number_of_plate * platePrice

totalCost = brickCost + plateCost

print "Number of Brick: {0:4}".format(number_of_brick)
print "Number of Plate: {0:4}".format(number_of_plate)
print "Bricks Cost: {0:6} €".format(brickCost)
print "Plates Cost: {0:6} €".format(plateCost)
print "--------------------"
print "Total Cost:  {0:6} €".format(totalCost)
# ---------- end ghpython_script_2 ----------
panel_4 = Panel(ghpython_script_2.out)
panel_5 = Panel(ghpython_script_2.totalCost)
