# Grasshopper definition woman.gh (Grasshopper 1.0.7)
# plug-ins: Weaverbird, Javid

path = FilePath("/Users/mp/Documents/GitHub/pixel-art/assets/woman.jpg")
open = OpenBitmap(File=path)
preview_bitmap = PreviewBitmap(Bitmap=open, LockAspect=False)
python = GhPythonScript(x=open)  # -> out, a, b
# ---------- python: Python ----------
__author__ = "mp"

import rhinoscriptsyntax as rs

a = x.Width
b = x.Height
# ---------- end python ----------
dice_dimension_mm = Panel("12")
panel = Panel(python.b)
panel_2 = Panel(python.a)
target_width_mm = Panel("1100")
division = Division(A=panel_2, B=panel)
division_2 = Division(A=target_width_mm, B=division)
division_3 = Division(A=target_width_mm, B=dice_dimension_mm)
division_4 = Division(A=division_2, B=dice_dimension_mm)
range = Range(Domain=target_width_mm, Steps=division_3)
range_2 = Range(Domain=division_2, Steps=division_4)
lng = ListLength(List=range_2)
lng_2 = ListLength(List=range)
rectangle = Rectangle(Plane=PlaneXY(0, 0, 0), XSize=target_width_mm, YSize=division_2, Radius=0)  # -> Rectangle, Length
range_3 = Range(Domain=Domain(0, 1), Steps=expr("x-1", lng_2))
multiplication = Multiplication(A=lng_2, B=lng)
crv = Curve([<curve referenced from the Rhino model> x2])
crv_2 = Curve([<curve referenced from the Rhino model> x3])
crv_3 = Curve([<curve referenced from the Rhino model> x4])
crv_4 = Curve([<curve referenced from the Rhino model> x5])
crv_5 = Curve([<curve referenced from the Rhino model> x6])
crv_6 = Curve([<curve referenced from the Rhino model> x7])
crv_7 = Curve(<curve referenced from the Rhino model>)
range_4 = Range(Domain=Domain(0, 1), Steps=expr("x-1", lng))
item = ListItem(Index=0, Wrap=True)
entwine = Entwine(
    Branch00=crv_7,
    Branch01=crv,
    Branch02=crv_2,
    Branch03=crv_3,
    Branch04=crv_4,
    Branch05=crv_5,
    Branch06=crv_6,
    FlattenInputs=True)
vec = VectorXYZ(XComponent=graft(range_3), YComponent=range_4, ZComponent=0)  # -> Vector, Length
split = SplitTree(Data=simplify(entwine), Masks=flatten("{0}"))  # -> Positive, Negative
image = ImageSampler(
    vec.Vector,
    FilePath="/Users/mp/Documents/GitHub/pixel-art/assets/woman.jpg",
    Filter="Value",
    Interpolate=False,
    Umax=1,
    Umin=0,
    Vmax=1,
    Vmin=0,
    Wrap=1)
srf = Surface(rectangle.Rectangle)
len = Length(Curve=split.Negative)
mesh_uv = MeshSurface(Surface=srf, UCount=lng_2, VCount=lng, Overhang=True, Equalize=False)
sort = SortList(Keys=len, ValuesA=split.Negative)  # -> Keys, reverse(ValuesA)
group = Group(Objects=sort.ValuesA)  # -> simplify(flatten(Group))
tstat = TreeStatistics(Tree=split.Negative)  # -> Paths, Length, Count
panel_3 = Panel(tstat.Count)
wbfacepolys = WeaverbirdsFacePolylines(Mesh=mesh_uv)
panel_4 = Panel(lng)
div = DivideDomain(Domain=Domain(0, 1), Count=panel_3)
demesh = DeconstructMesh(Mesh=mesh_uv)  # -> Vertices, Faces, Colours, Normals
partition = PartitionList(List=wbfacepolys, Size=panel_4)
fdom = FindDomain(Domains=div, Number=image, Strict=False)  # -> Index, Neighbour
item_2 = ListItem(List=group, Index=fdom.Index, Wrap=True)  # -> simplify(Item)
ungroup = Ungroup(Group=item_2)  # -> simplify(Objects)
item_3 = ListItem(List=ungroup, Index=0, Wrap=True)
cset = CreateSet(List=flatten(fdom.Index))  # -> Set, Map
explode = Explode(Curve=partition, Recursive=True)  # -> Segments, Vertices
explode_2 = Explode(Curve=item_3, Recursive=True)  # -> Segments, Vertices
item_4 = ListItem(List=explode_2.Vertices, Index=0, Wrap=True)  # -> Item, Item1, Item2
item_5 = ListItem(List=explode.Vertices, Index=0, Wrap=True)  # -> Item, Item1, Item2
mindex = MemberIndex()  # -> Index, Count
pl_3pt = Plane3Pt(PointA=item_4.Item, PointB=item_4.Item1, PointC=item_4.Item2)  # -> simplify(Plane)
pl_3pt_2 = Plane3Pt(PointA=item_5.Item, PointB=item_5.Item1, PointC=item_5.Item2)  # -> simplify(Plane)
morph = BoxMorph()
pshift = ShiftPaths(Data=pl_3pt, Offset=-1)
pshift_2 = ShiftPaths(Data=pl_3pt_2, Offset=-1)
orient = Orient(Geometry=item_2, Source=pshift, Target=pshift_2)  # -> Geometry, Transform
ungroup_2 = Ungroup(Group=orient.Geometry)
item_6 = ListItem(List=ungroup_2, Index=0, Wrap=True)
explode_3 = Explode(Curve=item_6, Recursive=True)  # -> Segments, Vertices
item_7 = ListItem(List=explode.Segments, Index=0, Wrap=True)  # -> simplify(Item)
item_8 = ListItem(List=explode_3.Segments, Index=0, Wrap=True)
len_2 = Length(Curve=item_8)  # -> simplify(Length)
len_3 = Length(Curve=item_7)  # -> simplify(Length)
end = EndPoints(Curve=item_8)  # -> simplify(Start), End
division_5 = Division(A=len_3, B=len_2)
pshift_3 = ShiftPaths(Data=end.Start, Offset=-1)
pshift_4 = ShiftPaths(Data=division_5, Offset=-1)
scale = Scale(Geometry=orient.Geometry, Center=pshift_3, Factor=pshift_4)  # -> Geometry, Transform
ungroup_3 = Ungroup(Group=scale.Geometry)
item_9 = ListItem(List=ungroup_3, Index=0, Wrap=True)
pcen = PolygonCenter(Polyline=item_9)  # -> CenterV, CenterE, CenterA
pshift_5 = ShiftPaths(Data=pcen.CenterV, Offset=-1)
scale_2 = Scale(Geometry=scale.Geometry, Center=pshift_5, Factor="0.99")  # -> Geometry, Transform
ungroup_4 = Ungroup(Group=scale_2.Geometry)
cull_i = CullIndex(List=ungroup_4, Indices="0", Wrap=True)
boundary = BoundarySurfaces(Edges=ungroup_4)
boundary_2 = BoundarySurfaces(Edges=cull_i)
preview = CustomPreview(Geometry=boundary_2, Material=ColourSwatch(SwatchColor=RGB(255, 255, 255)))
preview_2 = CustomPreview(Geometry=boundary, Material=ColourSwatch(SwatchColor=RGB(0, 0, 0)))
